# Grasshopper definition CreatingSendingGCodeInGrasshopper.gh (Grasshopper 1.0.7)
# plug-ins: Firefly, Pufferfish, Bifocals

# ---- group: Parameters
# Crv GCode Generators for 3D Printing 3-Axis
# Simple Vase Using Transformations
number_slider = Slider(100, range=0..100)
loop_length = Slider(10, range=0..10)
number_slider_2 = Slider(38, range=1..51)
curve_degree = Slider(1, range=1..3)
layer_height = Slider(1, range=0..1)
number_of_layers = Slider(100, range=0..1000)
rotation_domain_angle_start = Slider(0, range=0..360)
rotation_domain_angle_end = Slider(360, range=0..360)

# Snaking Pattern on a Surface
length_of_base_curve = Slider(123, range=0..200)
distance_between_crvs = Slider(3.674, range=0.5..101)

# ---- group: Creating a Base Curve
# Creating / Importing Curves
# Simple Vase Using Transformations
panel = Panel("0,0,0")
xy = XYPlane(Origin=panel)
cir = Circle(Plane=xy, Radius=Slider(95, range=0..100))

# ----
# Creating and Sending GCode in Grasshopper
# Background: This Grasshopper definition was created for a fall 2020 seminar at the Harvard Graduate School of Design called Material Systems: Digital Design and Fabrication.
# 
# This file provides various methods for creating and sending GCode to a Computer Numerically Controlled (CNC) Machine.
# 
# Sources
# Advanced 3D Printing with Grasshopper- Diego Garcia Cuevas and Gianluca Pugliese
# CNC Build Boundary
panel_2 = Panel("0,0,0")
xy_2 = XYPlane(Origin=panel_2)
# Rhinoceros Units = Millimeters
# Changing Units In Rhinoceros: To change your units in Rhinoceros, type units into the command bar. Then select millimeters as your model units.
rectangle = Rectangle(Plane=xy_2, XSize="375", YSize="305", Radius=0)  # -> Rectangle, Length
preview = CustomPreview(Geometry=rectangle.Rectangle, Material=ColourSwatch(SwatchColor=RGB(210, 21, 223)))

# ----
# Creating / Importing Curves
# Design / Curves Generated in Rhino
# How to Import Curves from Rhinoceros: 1. Right Click on the
# Primitive Curve Component above.
# 2. Select either set one curve or multiple curves depending on what your input from Rhinoceros.
# 3. Left Click on the Curves in Rhinceros.
# 4. To save the curves within the component you can right click once more and internalize the data.
setcurvefromrhino = Curve(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)

# ---- group: Locating the Polygon's Centoids the Number of Points Determines the Number of Polygons
# Creating / Importing Curves
# Polygon Design / Curves Generated in Grasshopper (Multiple)
panel_3 = Panel("0,0,0")
pt = Point(panel_3)
pt_2 = Point("0,100,0")
xy_3 = XYPlane(Origin=[pt_2, pt])

# ---- group: Parameters
number_of_points = Slider(14, range=0..20)
point_length = Slider(12, range=0..100)
crv_degree = Slider(1, range=1..5)

# ----
# Design / Curves Generated in Grasshopper
panel_4 = Panel("0,0,0")
xy_4 = XYPlane(Origin=panel_4)
polygon = Polygon(Plane=xy_4, Radius=Slider(52, range=0..100), Segments=Slider(4, range=3..10), FilletRadius=0)  # -> Polygon, Length

# ---- group: Parameters
number_slider_3 = Slider(40, range=0..100)
# Star Design / Curves Generated in Grasshopper (Multiple)
number_slider_4 = Slider(4, range=4..10)

# ---- group: Creating a Base Curve with Loops
xy_5 = XYPlane(Origin="0,0,0")
cir_2 = Circle(Plane=xy_5, Radius=number_slider)
offset = OffsetCurve(Curve=cir_2, Distance=loop_length, Plane=PlaneXY(0, 0, 0), Corners=1)
divide = DivideCurve(Curve=cir_2, Count=number_slider_2, Kinks=invert(False))  # -> Points, Tangents, Parameters
divide_2 = DivideCurve(Curve=offset, Count=number_slider_2, Kinks=invert(False))  # -> Points, Tangents, Parameters
dispatch = Dispatch(List=divide.Points, DispatchPattern=[True, False])  # -> ListA, ListB
dispatch_2 = Dispatch(List=divide_2.Points, DispatchPattern=[True, False])  # -> ListA, ListB
weave = Weave(Pattern=[0, 1], Stream0=dispatch.ListA, Stream1=dispatch_2.ListB, NullGaps=False)
intcrv = Interpolate(Vertices=flatten(weave), Degree=curve_degree, Periodic=invert(False), KnotStyle=1)  # -> Curve, Length, Domain

# ---- group: Base Curve
cir_3 = Circle(Plane=xy_3, Radius=number_slider_3)

Y = UnitY(Factor=1)
pt_3 = Point("0,0,0")
line = LineSDL(Start=pt_3, Direction=Y, Length=length_of_base_curve)

# ---- group: Creating Layers
number_of_layers_2 = Slider(57, range=0..100)
layer_height_2 = Slider(1, range=0..1)
series = Series(Start=0, Step=layer_height_2, Count=number_of_layers_2)
Z = UnitZ(Factor=series)
move = Move(Geometry=cir, Motion=Z)  # -> Geometry, Transform

# ---- group: Creating an Offset for the Star Points
offset_2 = OffsetCurve(Curve=cir_3, Distance=expr("-x", point_length), Plane=PlaneXY(0, 0, 0), Corners=1)
divide_3 = DivideCurve(Curve=offset_2, Count=number_of_points, Kinks=False)  # -> Points, Tangents, Parameters
dispatch_3 = Dispatch(List=divide_3.Points, DispatchPattern=[True, False])  # -> ListA, ListB

# ----
polygon_2 = Polygon(Plane=xy_3, Radius=number_slider_3, Segments=number_slider_4, FilletRadius=0)  # -> Polygon, Length

# ---- group: Dividing the Base Curve
divide_4 = DivideCurve(Curve=cir_3, Count=number_of_points, Kinks=False)  # -> Points, Tangents, Parameters
dispatch_4 = Dispatch(List=divide_4.Points, DispatchPattern=[True, False])  # -> ListA, ListB

# ---- group: Arraying the Crv
division = Division(A=length_of_base_curve, B=distance_between_crvs)
series_2 = Series(Start=0, Step=distance_between_crvs, Count=division)
X = UnitX(Factor=series_2)
move_2 = Move(Geometry=line, Motion=X)  # -> Geometry, Transform

# ---- group: Weaving the Data
weave_2 = Weave(Pattern=[0, 1], Stream0=dispatch_4.ListA, Stream1=dispatch_3.ListB, NullGaps=False)

# ---- group: Creating a Profile Shape
range = Range(Domain=Domain(0, 1), Steps=expr("x-1", number_of_layers_2))
graph = GraphMapper(
    range,
    x0=0,
    x1=1,
    y0=0,
    y1=1,
    container_name="Bezier",
    cpx=[0, 0.4791525006, 0.4942830503, 1],
    cpy=[0.3067007661, 0.7182546854, 0, 0.2431534529])
intensity = Slider(0.5, range=0..10)
multiplication = Multiplication(A=graph, B=intensity)
area = Area(Geometry=move.Geometry)  # -> Area, Centroid
scale = Scale(Geometry=move.Geometry, Center=area.Centroid, Factor=multiplication)  # -> Geometry, Transform

# ---- group: Creating Star by Interpolating Through the Points
intcrv_2 = Interpolate(Vertices=weave_2, Degree=crv_degree, Periodic=invert(False), KnotStyle=1)  # -> Curve, Length, Domain

# ---- group: Connecting the Arrayed Crvs into One Crv to Create the Base Layer
explode = Explode(Curve=move_2.Geometry, Recursive=True)  # -> Segments, flatten(Vertices)
dispatch_5 = Dispatch(List=explode.Vertices, DispatchPattern=[True, False, False, True])  # -> ListA, ListB
lng = ListLength(List=dispatch_5.ListA)
lng_2 = ListLength(List=dispatch_5.ListB)
series_3 = Series(Start=1, Step=1, Count=expr("x-1", lng))
series_4 = Series(Start=0, Step=1, Count=expr("x-1", lng_2))
item = ListItem(List=dispatch_5.ListB, Index=series_4, Wrap=True)
item_2 = ListItem(List=dispatch_5.ListA, Index=series_3, Wrap=True)
ln = Line(StartPoint=item_2, EndPoint=item)
weave_3 = Weave(Pattern=[0, 1], Stream0=flatten(explode.Segments), Stream1=ln, NullGaps=False)
join = JoinCurves(Curves=weave_3, Preserve=False)

# ---- group: Creating Layers
series_5 = Series(Start=0, Step=layer_height, Count=number_of_layers)
Z_2 = UnitZ(Factor=series_5)
move_3 = Move(Geometry=intcrv.Curve, Motion=Z_2)  # -> Geometry, Transform

# ---- group: Creating a Single Curve
divide_5 = DivideCurve(Curve=scale.Geometry, Count="150", Kinks=False)  # -> Points, Tangents, Parameters
intcrv_3 = Interpolate(Vertices=flatten(divide_5.Points), Degree=3, Periodic=False, KnotStyle=1)  # -> Curve, Length, Domain

# ---- group: Rotation
dom = ConstructDomain(DomainStart=rotation_domain_angle_start, DomainEnd=rotation_domain_angle_end)
area_2 = Area(Geometry=move_3.Geometry)  # -> Area, Centroid
range_2 = Range(Domain=dom, Steps=expr("x-1", number_of_layers))
xy_6 = XYPlane(Origin=area_2.Centroid)
rotate = Rotate(Geometry=move_3.Geometry, Angle=degrees(range_2), Plane=xy_6)  # -> Geometry, Transform

# ----
sample_surface = Surface(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)
project = Project(Curve=join, Brep=sample_surface, Direction=Vector(0, 0, 1))

# ---- group: Creating Profile
range_3 = Range(Domain=Domain(0, 1), Steps=expr("x-1", number_of_layers))
area_3 = Area(Geometry=rotate.Geometry)  # -> Area, Centroid
intensity_2 = Slider(1, range=0..1)
graph_2 = GraphMapper(range_3, x0=0, x1=1, y0=0, y1=1, Ox=0.5040584207, Oy=0.3959394693, Px=1, Py=0.1988366246, container_name="Parabola")
multiplication_2 = Multiplication(A=graph_2, B=intensity_2)
scale_2 = Scale(Geometry=rotate.Geometry, Center=area_3.Centroid, Factor=multiplication_2)  # -> Geometry, Transform

# ---- group: Creating a Single Curve
divide_6 = DivideCurve(Curve=scale_2.Geometry, Count="200", Kinks=False)  # -> Points, Tangents, Parameters
intcrv_4 = Interpolate(Vertices=flatten(divide_6.Points), Degree=curve_degree, Periodic=False, KnotStyle=1)  # -> Curve, Length, Domain

# ---- group: Single Input Curve to Plot
crv = Curve(polygon.Polygon)

# ---- group: Single or Multiple Input Curve(s) to Print
crv_2 = Curve(intcrv_2.Curve)

crv_3 = Curve(intcrv_3.Curve)

# ---- group: Single Input Curve to Plot
# Centering On Print Bed
crv_4 = Curve(intcrv_4.Curve)

# ---- group: Centering On Print Bed
bbox = BoundingBox(Content=crv_3, Plane=PlaneXY(0, 0, 0), UnionBox=True)  # -> Box, Box_2
area_4 = Area(Geometry=rectangle.Rectangle)  # -> Area, Centroid
debrep = DeconstructBrep(Brep=bbox.Box)  # -> Faces, Edges, Vertices
pdecon = Deconstruct(Point=area_4.Centroid)  # -> XComponent, YComponent, ZComponent
item_3 = ListItem(List=debrep.Faces, Index="4", Wrap=True)
pt_4 = ConstructPoint(XCoordinate=pdecon.XComponent, YCoordinate=pdecon.YComponent, ZCoordinate="0")
area_5 = Area(Geometry=item_3)  # -> Area, Centroid
pdecon_2 = Deconstruct(Point=pt_4)  # -> XComponent, YComponent, ZComponent
pdecon_3 = Deconstruct(Point=area_5.Centroid)  # -> XComponent, YComponent, ZComponent
subtraction = Subtraction(A=pdecon_2.XComponent, B=pdecon_3.XComponent)
subtraction_2 = Subtraction(A=pdecon_2.YComponent, B=pdecon_3.YComponent)
subtraction_3 = Subtraction(A=pdecon_2.ZComponent, B=pdecon_3.ZComponent)
vec = VectorXYZ(XComponent=subtraction, YComponent=subtraction_2, ZComponent=subtraction_3)  # -> Vector, Length
move_4 = Move(Geometry=crv_3, Motion=vec.Vector)  # -> Geometry, Transform

bbox_2 = BoundingBox(Content=crv, Plane=PlaneXY(0, 0, 0), UnionBox=True)  # -> Box, Box_2
area_6 = Area(Geometry=rectangle.Rectangle)  # -> Area, Centroid
debrep_2 = DeconstructBrep(Brep=bbox_2.Box)  # -> Faces, Edges, Vertices
pdecon_4 = Deconstruct(Point=area_6.Centroid)  # -> XComponent, YComponent, ZComponent
item_4 = ListItem(List=debrep_2.Faces, Index="4", Wrap=True)
pt_5 = ConstructPoint(XCoordinate=pdecon_4.XComponent, YCoordinate=pdecon_4.YComponent, ZCoordinate="0")
area_7 = Area(Geometry=item_4)  # -> Area, Centroid
pdecon_5 = Deconstruct(Point=pt_5)  # -> XComponent, YComponent, ZComponent
pdecon_6 = Deconstruct(Point=area_7.Centroid)  # -> XComponent, YComponent, ZComponent
subtraction_4 = Subtraction(A=pdecon_5.XComponent, B=pdecon_6.XComponent)
subtraction_5 = Subtraction(A=pdecon_5.YComponent, B=pdecon_6.YComponent)
subtraction_6 = Subtraction(A=pdecon_5.ZComponent, B=pdecon_6.ZComponent)
vec_2 = VectorXYZ(XComponent=subtraction_4, YComponent=subtraction_5, ZComponent=subtraction_6)  # -> Vector, Length
move_5 = Move(Geometry=crv, Motion=vec_2.Vector)  # -> Geometry, Transform

# ----
# Centering On Print Bed
bbox_3 = BoundingBox(Content=crv_2, Plane=PlaneXY(0, 0, 0), UnionBox=True)  # -> Box, Box_2
area_8 = Area(Geometry=rectangle.Rectangle)  # -> Area, Centroid
debrep_3 = DeconstructBrep(Brep=bbox_3.Box)  # -> Faces, Edges, Vertices
pdecon_7 = Deconstruct(Point=area_8.Centroid)  # -> XComponent, YComponent, ZComponent
item_5 = ListItem(List=debrep_3.Faces, Index="4", Wrap=True)
pt_6 = ConstructPoint(XCoordinate=pdecon_7.XComponent, YCoordinate=pdecon_7.YComponent, ZCoordinate="0")
area_9 = Area(Geometry=item_5)  # -> Area, Centroid
pdecon_8 = Deconstruct(Point=pt_6)  # -> XComponent, YComponent, ZComponent
pdecon_9 = Deconstruct(Point=area_9.Centroid)  # -> XComponent, YComponent, ZComponent
subtraction_7 = Subtraction(A=pdecon_8.XComponent, B=pdecon_9.XComponent)
subtraction_8 = Subtraction(A=pdecon_8.YComponent, B=pdecon_9.YComponent)
subtraction_9 = Subtraction(A=pdecon_8.ZComponent, B=pdecon_9.ZComponent)
vec_3 = VectorXYZ(XComponent=subtraction_7, YComponent=subtraction_8, ZComponent=subtraction_9)  # -> Vector, Length
move_6 = Move(Geometry=crv_2, Motion=vec_3.Vector)  # -> Geometry, Transform

# ---- group: Centering On Print Bed
bbox_4 = BoundingBox(Content=crv_4, Plane=PlaneXY(0, 0, 0), UnionBox=True)  # -> Box, Box_2
area_10 = Area(Geometry=rectangle.Rectangle)  # -> Area, Centroid
debrep_4 = DeconstructBrep(Brep=bbox_4.Box)  # -> Faces, Edges, Vertices
pdecon_10 = Deconstruct(Point=area_10.Centroid)  # -> XComponent, YComponent, ZComponent
pt_7 = ConstructPoint(XCoordinate=pdecon_10.XComponent, YCoordinate=pdecon_10.YComponent, ZCoordinate="0")
item_6 = ListItem(List=debrep_4.Faces, Index="4", Wrap=True)
area_11 = Area(Geometry=item_6)  # -> Area, Centroid
pdecon_11 = Deconstruct(Point=pt_7)  # -> XComponent, YComponent, ZComponent
pdecon_12 = Deconstruct(Point=area_11.Centroid)  # -> XComponent, YComponent, ZComponent
subtraction_10 = Subtraction(A=pdecon_11.XComponent, B=pdecon_12.XComponent)
subtraction_11 = Subtraction(A=pdecon_11.YComponent, B=pdecon_12.YComponent)
subtraction_12 = Subtraction(A=pdecon_11.ZComponent, B=pdecon_12.ZComponent)
vec_4 = VectorXYZ(XComponent=subtraction_10, YComponent=subtraction_11, ZComponent=subtraction_12)  # -> Vector, Length
move_7 = Move(Geometry=crv_4, Motion=vec_4.Vector)  # -> Geometry, Transform

# ----
# Centering On Print Bed
swatch = ColourSwatch(SwatchColor=RGB(161, 253, 20))
preview_2 = CustomPreview(Geometry=move_5.Geometry, Material=swatch)

# ----
# Centering On Print Bed
swatch_2 = ColourSwatch(SwatchColor=RGB(50, 191, 184))
preview_3 = CustomPreview(Geometry=move_6.Geometry, Material=swatch_2)

# ----
# Centering On Print Bed
swatch_3 = ColourSwatch(SwatchColor=RGB(50, 191, 184))
preview_4 = CustomPreview(Geometry=move_4.Geometry, Material=swatch_3)

# ---- group: Parameters
# Crv GCode Generator 3D Printer
polyline_tolerance_resolution = Slider(0.05, range=0.01..5)
heated_bed_temperature = Slider(60, range=0..100)
speed_or_feed_rate_mm_min = Slider(1500, range=500..2400)
extrusion_multiplier = Slider(0.05, range=0.01..10)
hot_end_temperature = Slider(200, range=0..1000)
number_of_decimal_places = Slider(3, range=1..5)

# ---- group: Converting to Polyline / Degree 1 Curve
topoly = CurveToPolyline(Curve=move_5.Geometry, ToleranceDistance=Slider(0.01, range=0.01..5), ToleranceAngle=0)  # -> Polyline, Segments

topoly_2 = CurveToPolyline(Curve=move_6.Geometry, ToleranceDistance=Slider(0.01, range=0.01..5), ToleranceAngle=0)  # -> Polyline, Segments

topoly_3 = CurveToPolyline(Curve=move_4.Geometry, ToleranceDistance=Slider(0.01, range=0.01..5), ToleranceAngle=0)  # -> Polyline, Segments

polyline_tolerance_resolution_2 = Slider(0.05, range=0.01..5)
topoly_4 = CurveToPolyline(Curve=move_4.Geometry, ToleranceDistance=polyline_tolerance_resolution_2, ToleranceAngle=0)  # -> Polyline, Segments

topoly_5 = CurveToPolyline(Curve=move_7.Geometry, ToleranceDistance=polyline_tolerance_resolution, ToleranceAngle=0)  # -> Polyline, Segments

# ---- group: Exploding Polyline and Obtaining the Segment Lengths
explode_2 = Explode(Curve=topoly_5.Polyline, Recursive=True)  # -> Segments, Vertices
len = Length(Curve=explode_2.Segments)

# ---- group: Obtaining Control Points for Coordinates
cp = ControlPoints(Curve=topoly.Polyline)  # -> Points, Weights, Knots

cp_2 = ControlPoints(Curve=topoly_2.Polyline)  # -> Points, Weights, Knots

cp_3 = ControlPoints(Curve=topoly_5.Polyline)  # -> Points, Weights, Knots

cp_4 = ControlPoints(Curve=topoly_3.Polyline)  # -> Points, Weights, Knots

# ---- group: Prevents the Extrusion of Material Between Separate Polylines
ins = InsertItems(List=len, Item="0", Indices="0", Wrap=True)

# ---- group: X and Y Axis GCode
pdecon_13 = Deconstruct(Point=flatten(cp_4.Points))  # -> XComponent, YComponent, ZComponent
concat = Concatenate(FragmentA="G1", FragmentB="X", FragmentC=pdecon_13.XComponent, FragmentD=" Y", FragmentE=pdecon_13.YComponent)

# ---- group: Obtaining Control Points for Coordinates
cp_5 = ControlPoints(Curve=topoly_4.Polyline)  # -> Points, Weights, Knots

# ----
# Crv GCode Generator 2-Axis CNC with Servo Motor (Z-Axis)
panel_5 = Panel(" F")
feed_rate_mm_s = Slider(500, range=10..1500)

# ---- group: X and Y Axis GCode
pdecon_14 = Deconstruct(Point=flatten(cp_2.Points))  # -> XComponent, YComponent, ZComponent
concat_2 = Concatenate(
    FragmentA="G1 ",
    FragmentB="X",
    FragmentC=pdecon_14.XComponent,
    FragmentD=" Y",
    FragmentE=pdecon_14.YComponent,
    FragmentF=panel_5,
    FragmentG=feed_rate_mm_s)

# ---- group: Extrusion Rates
ma = MassAddition(Input=flatten(ins))  # -> Result, PartialResults

# ---- group: Extrusion Multiplier
multiplication_3 = Multiplication(A=ma.PartialResults, B=extrusion_multiplier)
extrusion_multiplier_2 = Panel(multiplication_3)

# ----
# Simple Crv GCode Generator 3-Axis CNC
panel_6 = Panel(" F")

# ----
# Right click on the panel.
# Select Copy Data Only.
# Paste into NotePad or
# similar text reader like
# Sublime.
pdecon_15 = Deconstruct(Point=flatten(cp_5.Points))  # -> XComponent, YComponent, ZComponent
feed_speed_mm_s = Slider(500, range=10..1500)
concat_3 = Concatenate(
    FragmentA="G1",
    FragmentB="X",
    FragmentC=pdecon_15.XComponent,
    FragmentD=" Y",
    FragmentE=pdecon_15.YComponent,
    FragmentF=" Z",
    FragmentG=pdecon_15.ZComponent,
    FragmentH=panel_6,
    FragmentI=feed_speed_mm_s)  # -> flatten(Result)
gcode = Panel(concat_3)

# ---- group: Adding an Additional Start Point Before Dropping Pen to Ensure it is at the Proper Location
item_7 = ListItem(List=concat_2, Index=0, Wrap=True)
start_points_of_each_crv = Panel(item_7)
lng_3 = ListLength(List=cp_2.Points)
ins_2 = InsertItems(List=concat_2, Item=item_7, Indices=expr("x+1", lng_3), Wrap=True)

# ----
# Right click on the panel.
# Select Copy Data Only.
# Paste into NotePad or
# similar text reader like
# Sublime.
pdecon_16 = Deconstruct(Point=flatten(cp_3.Points))  # -> XComponent, YComponent, ZComponent
roundd = RoundToDecimalPlace(NumberX=multiplication_3, DecimalPlace=number_of_decimal_places, RoundType=0)  # -> Rounded, Difference
concat_4 = Concatenate(
    FragmentA="G1",
    FragmentB="X",
    FragmentC=pdecon_16.XComponent,
    FragmentD=" Y",
    FragmentE=pdecon_16.YComponent,
    FragmentF=" Z",
    FragmentG=pdecon_16.ZComponent,
    FragmentI=" E",
    FragmentH=roundd.Rounded,
    FragmentJ=" F",
    FragmentK=speed_or_feed_rate_mm_min)
start_gcode = Panel("""G28 ;Home Machine
M140 S{1} ; Bed temp
M109 R{0} ; wait for extruder to reach printing temp
M190 R{1} ;wait for the bed to reach temp""")
end_gcode = Panel("""G28 ;Home Machine
M109 R0 ;disable hotend 
M104 S0 ;disable bed""")
format = Format(Format=start_gcode, Culture=127, Data0=hot_end_temperature, Data1=heated_bed_temperature)
merge = Merge(Data1=format, Data2=flatten(concat_4), Data3=end_gcode)
gcode_2 = Panel(merge)

# ---- group: Dropping Pen
lng_4 = ListLength(List=ins_2)
ins_3 = InsertItems(List=ins_2, Item="M5 ;Pen Down", Indices=expr("x+2", lng_4), Wrap=True)
pen_down = Panel(ins_3)

# ---- group: Adding Pen Up
panel_7 = Panel("M3 S90 ;Pen Up")
lng_5 = ListLength(List=ins_3)
ins_4 = InsertItems(List=ins_3, Item=panel_7, Indices=lng_5, Wrap=True)
pen_up = Panel(ins_4)

# ---- group: Merging Start, Middle and End GCode
end_gcode_2 = Panel("X0 Y0 ;Home")
merge_2 = Merge(Data1=flatten(panel_7), Data2=flatten(ins_4), Data3=end_gcode_2)

# ---- group: GCode
# Right click on the panel.
# Select Copy Data Only.
# Paste into NotePad or
# similar text reader like
# Sublime.
gcode_3 = Panel(merge_2)

# ---- group: Ports Available
# Sending to CNC with Serial Connection Using Firefly Plugin
ports_available = COMPortsAvailable()
ports_available_2 = Panel(ports_available)

# ---- group: Opening Serial Port
panel_8 = Panel("3")
open_port = OpenClosePort(OpenClosePort=Toggle(True), PortNumber=panel_8, BaudRate="115200")
panel_9 = Panel(open_port)

# ---- group: Home Machine
home_machine = Button()
home = Panel("X0 Y0 Z0")
write = SerialWriteGeneric(StartWritingValues=home_machine, WriteData=home, PortNumber=panel_8)  # -> ArduinoOutput, StatusMessage

# ---- group: Jogging the Machine
sending_toolpaths = Button()
x_axis = Slider(0, range=0..375)
y_axis = Slider(0, range=0..305)
z_axis = Slider(0, range=0..255)
feed_speed_mm_s_2 = Slider(500, range=10..1500)
concat_5 = Concatenate(
    FragmentA="G1 ",
    FragmentB="X",
    FragmentC=x_axis,
    FragmentD=" Y",
    FragmentE=y_axis,
    FragmentH="Z",
    FragmentI=z_axis,
    FragmentF=" F",
    FragmentG=feed_speed_mm_s_2)  # -> flatten(Result)
gcode_4 = Panel(concat_5)
write_2 = SerialWriteGeneric(StartWritingValues=sending_toolpaths, WriteData=gcode_4, PortNumber=panel_8)  # -> ArduinoOutput, StatusMessage

# ---- group: Servomotor Jogging the Machine
sending_toolpaths_2 = Button()
x_axis_2 = Slider(0, range=0..375)
y_axis_2 = Slider(0, range=0..305)
feed_speed_mm_s_3 = Slider(500, range=10..1500)
concat_6 = Concatenate(
    FragmentA="G1 ",
    FragmentB="X",
    FragmentC=x_axis_2,
    FragmentD=" Y",
    FragmentE=y_axis_2,
    FragmentH=" F",
    FragmentG=feed_speed_mm_s_3)  # -> flatten(Result)
gcode_5 = Panel(concat_6)
merge_3 = Merge(Data1="M3 S90 ;Pen Up", Data2=gcode_5)
write_3 = SerialWriteGeneric(StartWritingValues=sending_toolpaths_2, WriteData=merge_3, PortNumber=panel_8)  # -> ArduinoOutput, StatusMessage

# ---- group: Parameters
length_of_tile = Slider(60, range=0..609)
distance_between_crvs_2 = Slider(11, range=3..101)
# Single Curve Based Tile
crv_intensity = Slider(15, range=5..500)
layer_height_3 = Slider(1, range=0..10)
number_of_layers_3 = Slider(6, range=2..10)

# ---- group: Making the Base Crv
range_4 = Range(Domain=Domain(0, 1), Steps=expr("x-1", length_of_tile))
series_6 = Series(Start=0, Step=1, Count=length_of_tile)
graph_3 = GraphMapper(range_4, x0=0, x1=1, y0=0, y1=1, container_name="Sine", Equation_px=[0, 0.07671588659], Equation_py=[0, 0.5321960449])
multiplication_4 = Multiplication(A=graph_3, B=crv_intensity)
pt_8 = ConstructPoint(XCoordinate=multiplication_4, YCoordinate=series_6, ZCoordinate=0)  # -> flatten(Point)
nurbs = NurbsCurve(Vertices=pt_8, Degree=3, Periodic=False)  # -> Curve, Length, Domain

# ---- group: Arraying the Crv
division_2 = Division(A=length_of_tile, B=distance_between_crvs_2)
round = Round(Number=division_2)  # -> Nearest, Floor, Ceiling
series_7 = Series(Start=0, Step=distance_between_crvs_2, Count=division_2)
X_2 = UnitX(Factor=series_7)
move_8 = Move(Geometry=nurbs.Curve, Motion=X_2)  # -> Geometry, Transform

# ---- group: Parameters (continued)
number_of_passes = Panel(round.Nearest)

# ---- group: Connecting the Arrayed Crvs into One Crv to Create the Base Layer
explode_3 = Explode(Curve=move_8.Geometry, Recursive=True)  # -> Segments, flatten(Vertices)
dispatch_6 = Dispatch(List=explode_3.Vertices, DispatchPattern=[True, False, False, True])  # -> ListA, ListB
lng_6 = ListLength(List=dispatch_6.ListA)
lng_7 = ListLength(List=dispatch_6.ListB)
series_8 = Series(Start=1, Step=1, Count=expr("x-1", lng_6))
series_9 = Series(Start=0, Step=1, Count=expr("x-1", lng_7))
item_8 = ListItem(List=dispatch_6.ListA, Index=series_8, Wrap=True)
item_9 = ListItem(List=dispatch_6.ListB, Index=series_9, Wrap=True)
ln_2 = Line(StartPoint=item_8, EndPoint=item_9)
weave_4 = Weave(Pattern=[0, 1], Stream0=flatten(explode_3.Segments), Stream1=ln_2, NullGaps=False)
join_2 = JoinCurves(Curves=weave_4, Preserve=False)

# ---- group: Second Layer
bbox_5 = BoundingBox(Content=join_2, Plane=PlaneXY(0, 0, 0))  # -> Box, Box_2
area_12 = Area(Geometry=bbox_5.Box)  # -> Area, Centroid
yz = YZPlane(Origin=area_12.Centroid)
mirror = Mirror(Geometry=join_2, Plane=yz)  # -> Geometry, Transform
xy_7 = XYPlane(Origin=area_12.Centroid)
_90 = Number(90)
rotate_2 = Rotate(Geometry=mirror.Geometry, Angle=degrees(_90), Plane=xy_7)  # -> Geometry, Transform

# ---- group: Creating Layers and Weaving Data
series_10 = Series(Start=0, Step=expr("x*2", layer_height_3), Count=expr("x/2", number_of_layers_3))
series_11 = Series(Start=layer_height_3, Step=expr("x*2", layer_height_3), Count=expr("x/2", number_of_layers_3))
Z_3 = UnitZ(Factor=series_10)
Z_4 = UnitZ(Factor=series_11)
move_9 = Move(Geometry=rotate_2.Geometry, Motion=Z_3)  # -> Geometry, Transform
move_10 = Move(Geometry=join_2, Motion=Z_4)  # -> Geometry, Transform
weave_5 = Weave(Pattern=[0, 1], Stream0=move_9.Geometry, Stream1=move_10.Geometry, NullGaps=False)  # -> flatten(Weave)

# ---- group: Dividing the Crvs and Weaving into a Single Crv
divide_7 = DivideCurve(Curve=weave_5, Count=10000, Kinks=False)  # -> flatten(Points), Tangents, Parameters
nurbs_2 = NurbsCurve(Vertices=divide_7.Points, Degree=3, Periodic=False)  # -> Curve, Length, Domain

# ---- group: Creating GCode
# To save the GCode,
# right click on the panel.
# Select Copy Data Only.
# Paste into NotePad or
# similar text reader like
# Sublime.
pdecon_17 = Deconstruct(Point=flatten(cp.Points))  # -> XComponent, YComponent, ZComponent
controlled_motion = Panel("G1")
feed_rate_mm_s_2 = Slider(500, range=10..1500)

# ----
# Crv GCode Generator 2-Axis CNC
x_values = Panel(pdecon_17.XComponent)
y_values = Panel(pdecon_17.YComponent)
z_values = Panel(pdecon_17.ZComponent)
home_2 = Panel("X0 Y0 Z0 ;Home")

# ---- group: Creating GCode (continued)
concat_7 = Concatenate(
    FragmentA=controlled_motion,
    FragmentB=" X",
    FragmentC=pdecon_17.XComponent,
    FragmentD=" Y",
    FragmentE=pdecon_17.YComponent,
    FragmentF="Z",
    FragmentG=pdecon_17.ZComponent,
    FragmentH=" F",
    FragmentI=feed_rate_mm_s_2)  # -> flatten(Result)
basic_gcode = Panel(concat_7)

# ----
merge_4 = Merge(Data1=basic_gcode, Data2=home_2)

# ---- group: Creating GCode (continued)
gcode_6 = Panel(merge_4)

# ---- group: Sending Toolpaths
sending_toolpaths_3 = Button()
gcode_7 = Panel(gcode_6)
write_4 = SerialWriteGeneric(StartWritingValues=sending_toolpaths_3, WriteData=gcode_7, PortNumber=panel_8)  # -> ArduinoOutput, StatusMessage

# ---- group: Drop Tool at Curve Start
item_10 = ListItem(List=concat, Index=0, Wrap=True)
start_points_of_each_crv_2 = Panel(item_10)
lng_8 = ListLength(List=cp_4.Points)

# ----
# Crv GCode Generator 3-Axis CNC with Stepper Motor
panel_10 = Panel(" Z")
concat_8 = Concatenate(FragmentA=start_points_of_each_crv_2, FragmentB=panel_10, FragmentC="0")
panel_11 = Panel(concat_8)

# ---- group: Drop Tool at Curve Start (continued)
ins_5 = InsertItems(List=concat, Item=panel_11, Indices=expr("x+1", lng_8), Wrap=True)

# ---- group: Tool Up
tool_up_height = Slider(20, range=0..100)
concat_9 = Concatenate(FragmentA=item_10, FragmentB=" Z", FragmentC=tool_up_height)
tool_up = Panel(concat_9)
lng_9 = ListLength(List=ins_5)

# ---- group: Tool Up / Curve Start
ins_6 = InsertItems(List=ins_5, Item=tool_up, Indices=expr("x+1", lng_9), Wrap=True)

# ---- group: Tool Up / Curve End
ins_7 = InsertItems(List=ins_6, Item=tool_up, Indices=expr("x+1", lng_9), Wrap=True)

# ---- group: Adding Feed Rate
feed_speed_mm_s_4 = Slider(500, range=10..1500)
concat_10 = Concatenate(FragmentA=ins_7, FragmentB=" F", FragmentC=feed_speed_mm_s_4)

# ----
logic_check = Panel(ins_6)
logic_check_2 = Panel(ins_7)
logic_check_3 = Panel(concat_10)

# ---- group: Start and End Code
concat_11 = Concatenate(FragmentA="X", FragmentB="0", FragmentC=" Y", FragmentD="0", FragmentE=" Z", FragmentF=tool_up_height)
panel_12 = Panel(concat_11)

# ---- group: Merging Start, Middle and End GCode
merge_5 = Merge(Data1=concat_11, Data2=flatten(concat_10), Data3=concat_11)

# ---- group: GCode
# Right click on the panel.
# Select Copy Data Only.
# Paste into NotePad or
# similar text reader like
# Sublime.
gcode_8 = Panel(merge_5)
